# Grasshopper definition gis_emulator .gh (Grasshopper 1.0.7)

panel = Panel("""深圳宝田医院-急诊
健丰医院-急诊
石岩人民医院-急诊科
深圳神源医院-肖传国医院急诊
深圳六联医院-急诊
龙翔医院-急诊
深圳龙安医院-恒生龙安医院急诊
东部华侨城救护站
香蜜湖度假村应急避难所应急医疗救护
南方医科大学深圳恒生医院急救中心
南方医科大学附属恒生医院-120院前急救办公楼
宝安人民医院-院前急救科
深圳市第二人民医院急救中心
深圳120急诊急救医院
松岗人民医院院前急救科
光明新区人民医院-急救科
上南急救中心
沙井医疗急救中心
凤凰急救
深圳雪象医院急救
深圳市机场医疗急救中心
宝安区中心医院院前急救黄田分站""")
panel_2 = Panel("""22.783089
22.70109
22.678472
22.656824
22.641388
22.643749
22.63503
22.605186
22.546767
22.577008
22.577119
22.56217
22.55655
22.616535
22.775332
22.764312
22.719675
22.719548
22.691382
22.651396
22.641889
22.630054""")
panel_3 = Panel("""113.876112
114.330479
113.941169
114.07049
114.19504
114.204538
114.02181
114.306078
114.027686
113.852717
113.85276
113.91379
114.085966
114.139597
113.840788
113.902561
113.839846
113.839972
113.833886
114.07856
113.824586
113.844254""")
panel_4 = Panel("""松岗人民医院院前急救科
光明新区人民医院-急救科
上南急救中心
沙井医疗急救中心
凤凰急救
深圳雪象医院急救
深圳市机场医疗急救中心
宝安区中心医院院前急救黄田分站
宝安区中心医院-急救中心
深圳宝田医院-急诊
健丰医院-急诊
石岩人民医院-急诊科
深圳神源医院-肖传国医院急诊
深圳六联医院-急诊
龙翔医院-急诊
深圳龙安医院-恒生龙安医院急诊
东部华侨城救护站
香蜜湖度假村应急避难所应急医疗救护
深圳120急诊急救医院
南方医科大学深圳恒生医院急救中心
南方医科大学附属恒生医院-120院前急救办公楼
宝安人民医院-院前急救科
深圳市第二人民医院急救中心
深圳市龙岗区坪地人民医院急诊
深圳市宝安区松岗人民医院急诊
深圳复亚医院-急诊部
深圳市光明新区人民医院急诊科
深圳市光明新区中心医院急诊
深圳市宝安区沙井人民医院急诊科
新桥医院急诊部
龙岗中心医院
深圳市龙岗中心医院急诊
深圳万丰医院-急诊部
深圳市龙岗区人民医院急诊
深圳市龙岗区第三人民医院急诊
深圳九龙男科医院-急症部
观澜人民医院-急诊
深圳市龙岗区中医院急诊科
深圳龙城医院急诊
深圳广生医院急诊科
福永人民医院凤凰分院
深圳市龙岗区平湖人民医院急诊
暨南大学附属深圳华侨医院急诊
深圳市坪山新区人民医院急诊科
深圳市宝安区福永人民医院急诊
深圳市人民医院龙华分院急诊科
深圳龙济医院急诊部
深圳市龙华新区人民医院急诊
深圳雪象医院急诊
深圳市龙岗区第三人民医院急诊
深圳市第三人民医院综合急诊
深圳宝兴医院-急诊
深圳坂田医院急诊
深圳百合医院急诊
沙湾人民医院急诊科
深圳市龙岗区第二人民医院急诊
深圳市龙岗区第二人民医院门诊部
深圳罗岗医院急诊
西丽人民医院急诊
深圳市盐田区第二人民医院急诊
南方医科大学附属恒生医院急诊楼
深圳市宝安中医院急诊
公安边防部队总医院急诊科
深圳市宝安人民医院急诊楼
深圳龙珠医院急诊
深圳岭南医院急诊科
北京大学深圳医院急诊
广州中医药大学深圳医院急诊
深圳市第二人民医院-急诊中心
深圳市第十二人民医院-急诊部
深圳市人民医院急诊
深圳五洲中西医结合医院急诊
沙河医院沙河社区健康服务中心-急诊
深圳景田医院急诊
深圳曙光医院急诊
深圳市罗湖区中医院急诊
深圳市第四人民医院急诊科
深圳市中医院急诊
罗湖医院急诊
深圳流花医院急诊
深圳市蛇口人民医院急诊科""")
panel_5 = Panel("""113.840788
113.902561
113.839846
113.839972
113.833886
114.07856
113.824586
113.844254
113.880059
113.876112
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""")
panel_6 = Panel("""22.775332
22.764312
22.719675
22.719548
22.691382
22.651396
22.641889
22.630054
22.580572
22.783089
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""")
point = Point(Point(-4113.205034, -4699.772379, 0))
point_2 = Point(Point(3435.989011, 6234.513501, 0))
deconstruct_vector = DeconstructVector(Vector=point)  # -> XComponent, YComponent, ZComponent
deconstruct_vector_2 = DeconstructVector(Vector=point_2)  # -> XComponent, YComponent, ZComponent
number = Number(panel_6)
number_2 = Number(panel_5)
ghpython_script = GhPythonScript(x=number, y=number_2)  # -> out, a
# ---------- ghpython_script: Python ----------
__author__ = "henry"
__version__ = "2018.10.28"

import rhinoscriptsyntax as rs
import math

x_pi = 3.14159265358979324 * 3000.0 / 180.0
pi = 3.1415926535897932384626  # π
a = 6378245.0  # 长半轴
ee = 0.00669342162296594323  # 偏心率平方

def _transformlat(lng, lat):
    ret = -100.0 + 2.0 * lng + 3.0 * lat + 0.2 * lat * lat + 0.1 * lng * lat + 0.2 * math.sqrt(math.fabs(lng))
    ret += (20.0 * math.sin(6.0 * lng * pi) + 20.0 * math.sin(2.0 * lng * pi)) * 2.0 / 3.0
    ret += (20.0 * math.sin(lat * pi) + 40.0 * math.sin(lat / 3.0 * pi)) * 2.0 / 3.0
    ret += (160.0 * math.sin(lat / 12.0 * pi) + 320 * math.sin(lat * pi / 30.0)) * 2.0 / 3.0
    return ret


def _transformlng(lng, lat):
    ret = 300.0 + lng + 2.0 * lat + 0.1 * lng * lng + 0.1 * lng * lat + 0.1 * math.sqrt(math.fabs(lng))
    ret += (20.0 * math.sin(6.0 * lng * pi) + 20.0 * math.sin(2.0 * lng * pi)) * 2.0 / 3.0
    ret += (20.0 * math.sin(lng * pi) + 40.0 * math.sin(lng / 3.0 * pi)) * 2.0 / 3.0
    ret += (150.0 * math.sin(lng / 12.0 * pi) + 300.0 * math.sin(lng / 30.0 * pi)) * 2.0 / 3.0
    return ret

def gcj02_to_wgs84(lng, lat):
    """
    GCJ02(火星坐标系)转GPS84
    :param lng:火星坐标系的经度
    :param lat:火星坐标系纬度
    :return:
    """

    lng = float(lng)
    lat = float(lat)
    
    dlat = _transformlat(lng - 105.0, lat - 35.0)
    dlng = _transformlng(lng - 105.0, lng - 35.0)
    radlat = lat / 180.0 * pi
    magic = math.sin(radlat)
    magic = 1 - ee * magic * magic
    sqrtmagic = math.sqrt(magic)
    dlat = (dlat * 180.0) / ((a * (1 - ee)) / (magic * sqrtmagic) * pi)
    dlng = (dlng * 180.0) / (a / sqrtmagic * math.cos(radlat) * pi)
    mglat = lat + dlat
    mglng = lng + dlng
    return [lng * 2 - mglng, lat * 2 - mglat]

num1 = x
num2 = y

a = gcj02_to_wgs84(num1,num2)
# ---------- end ghpython_script ----------
panel_7 = Panel(ghpython_script.a)
construct_domain = ConstructDomain(DomainStart=deconstruct_vector.YComponent, DomainEnd=deconstruct_vector_2.YComponent)
construct_domain_2 = ConstructDomain(DomainStart="22.5559139", DomainEnd="22.6151555")
construct_domain_3 = ConstructDomain(DomainStart=deconstruct_vector.XComponent, DomainEnd=deconstruct_vector_2.XComponent)
construct_domain_4 = ConstructDomain(DomainStart="114.0014083", DomainEnd="114.10788")
list_item = ListItem(List=panel_7, Index=0, Wrap=True)
list_item_2 = ListItem(List=panel_7, Index=1, Wrap=True)
remap_numbers = RemapNumbers(Value=list_item_2, Source=construct_domain_4, Target=construct_domain)  # -> Mapped, Clipped
remap_numbers_2 = RemapNumbers(Value=list_item, Source=construct_domain_2, Target=construct_domain_3)  # -> Mapped, Clipped
panel_8 = Panel(list_item)
panel_9 = Panel(remap_numbers_2.Mapped)
panel_10 = Panel(remap_numbers.Mapped)
vector_xyz = VectorXYZ(XComponent=remap_numbers.Mapped, YComponent=remap_numbers_2.Mapped, ZComponent=0)  # -> Vector, Length
point_3 = Point(flatten(vector_xyz.Vector))
list_item_3 = ListItem(List=flatten(point_3), Index=Slider(12, range=0..22), Wrap=True)
panel_11 = Panel(point_3)
point_4 = Point(list_item_3)
circle = Circle(Plane=point_3, Radius=5000)  # disabled
point_5 = Point(point_3)
divide_curve = DivideCurve(Curve=circle, Count=20, Kinks=False)  # -> Points, Tangents, Parameters
text_tag_3d = TextTag3D(Location=point_5, Text=panel_4, Size=300, Justification=2)
line = Line(StartPoint=divide_curve.Points, EndPoint=graft(circle))
curve = Curve([<curve referenced from the Rhino model> x5000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])
end_points = EndPoints(Curve=curve)  # -> Start, End
point_in_curve = PointInCurve(Point=end_points.Start, Curve=graft(circle))  # -> Relationship, Point
point_in_curve_2 = PointInCurve(Point=end_points.End, Curve=graft(circle))  # -> Relationship, Point
equality = Equality(FirstNumber=point_in_curve_2.Relationship, SecondNumber=2)  # -> Equality, Inequality
equality_2 = Equality(FirstNumber=point_in_curve.Relationship, SecondNumber=2)  # -> Equality, Inequality
gate_and = GateAnd(A=equality_2.Equality, B=equality.Equality)
cull_pattern = CullPattern(List=curve, CullPattern=gate_and)
curve_2 = Curve(cull_pattern)
end_points_2 = EndPoints(Curve=cull_pattern)  # -> Start, End
curve_closest_point = CurveClosestPoint(Point=end_points_2.Start, Curve=graft(circle))  # -> Point, Parameter, Distance
panel_12 = Panel(cull_pattern)
distance = Distance(PointA=end_points_2.Start, PointB=curve_closest_point.Point)
sort_list = SortList(Keys=distance, ValuesValuesA=cull_pattern)  # -> Keys, ValuesValuesA
param_viewer = ParamViewer(sort_list.ValuesValuesA)
split_list = SplitList(List=sort_list.ValuesValuesA, Index=100)  # -> ListA, ListB
curve_3 = Curve(split_list.ListA)
panel_13 = Panel(sort_list.ValuesValuesA)
end_points_3 = EndPoints(Curve=curve_3)  # -> Start, End
flip_matrix = FlipMatrix(Data=end_points_3.Start)
list_item_4 = ListItem(List=flip_matrix, Index=0, Wrap=True)
simplify_tree = SimplifyTree(Tree=list_item_4, Front=False)  # -> flatten(Tree)
prune_tree = PruneTree(Tree=end_points_3.Start, Minimum=0, Maximum=0)
interpolate = Interpolate(Vertices=simplify_tree, Degree=1, Periodic=False, KnotStyle=1)  # -> Curve, Length, Domain
panel_14 = Panel(simplify_tree)
