# Grasshopper definition serve_range.gh (Grasshopper 1.0.7)
# plug-ins: Anemone, Kangaroo2 Components

curve = Curve([<curve referenced from the Rhino model> x31])
point = Point(<point referenced from the Rhino model>)
explode = Explode(Curve=curve, Recursive=True)  # -> flatten(Segments), Vertices
curve_closest_point = CurveClosestPoint(Point=point, Curve=explode.Segments)  # -> Point, Parameter, Distance
distance = Distance(PointA=point, PointB=curve_closest_point.Point)
sort_list = SortList(Keys=distance, ValuesValuesA=explode.Segments)  # -> Keys, flatten(ValuesValuesA)
panel = Panel(explode.Segments)
curve_2 = Curve(sort_list.ValuesValuesA)
ghpython_script = GhPythonScript(curves=curve_2)  # -> out, curve_result, i; inputs curves: list of Curve
# ---------- ghpython_script: Python ----------
__author__ = "Henry"
__version__ = "2018.12.10"

import rhinoscriptsyntax as rs

curve = curves

curve_result = curve[0]
num = len(curve)
i = 0

curve_group = [curve[0]]

while (not rs.IsCurveClosed(curve_result)):
    i = i+1
    curve2 = curve[i]
    curve_group.append(curve2)
    id = rs.JoinCurves(curve_group)
    curve_result = id[0]


## Determine the closest polygon
# ---------- end ghpython_script ----------
curve_3 = Curve(ghpython_script.curve_result)
explode_2 = Explode(Curve=curve_3, Recursive=True)  # -> Segments, Vertices
integer = Integer(expr("x+1", ghpython_script.i))
split_list = SplitList(List=curve_2, Index=integer)  # -> ListA, ListB
curve_4 = Curve(split_list.ListB)
point_2 = Point(explode_2.Vertices)
point_3 = Point(point_2)
cull_index = CullIndex(List=point_3, Indices=0, Wrap=True)
point_4 = Point(cull_index)
ghpython_script_2 = GhPythonScript(origin=point, points=point_4, curves=curve_4)  # -> route_output; inputs origin: Point3d, points: list of Point3d, curves: list of Curve
# ---------- ghpython_script_2: Python ----------
__author__ = "Henry"
__version__ = "2018.12.10"

import rhinoscriptsyntax as rs

serve_range = 10

final_route = []

def curve_flip_determine(curve,origin1):
    a1 = rs.CurveStartPoint(curve)
    a2 = rs.CurveEndPoint(curve)
    l1 = rs.AddLine(a1,origin1)
    l2 = rs.AddLine(a2,origin1)
    if (rs.CurveLength(l1) > rs.CurveLength(l2)):
        temp = a1
        a1 = a2
        a2 = temp
    new = rs.AddLine(a1,a2)
    return(new)

def remove_duplicate(point_group):
    duplicate_group = []
    for i in point_group:
        point_group_temp = point_group
        point_group_temp.remove(i)
        new_group_temp = point_group_temp
        for j in new_group_temp:
            if (i == j):
                duplicate_group.append(i)
    for i in duplicate_group:
        try:
            point_group.remove(i)
            break
        except:
            print('oops')
    return(point_group)

def curve_cross_join(curve1,curve2):
    output = []

    for i in curve1:
        for j in curve2:
            if (rs.CurveStartPoint(j) == rs.CurveEndPoint(i)):
                id = rs.JoinCurves([i,j])
                output.append(id[0])
    return(output)

def grow(point,origin,curve):
    
    new_curve = []

    for i in curve:
        new_curve.append(curve_flip_determine(i,origin))  ## flip the lines to orient to the origin point

    route = []
    check = []


    for i in new_curve:
        for j in point:
            if (rs.CurveStartPoint(i) == j):
                route.append(i)

    points_deduplicate = []

    for i in route:
        points_deduplicate.append(rs.CurveEndPoint(i))

    points_deduplicate = remove_duplicate(points_deduplicate)
    
    return(route,points_deduplicate)


route11, points_deduplicate11 = grow(points,origin,curves)

route22, points_deduplicate22 = grow(points_deduplicate11,origin,curves)

route_output = curve_cross_join(route11,route22)

def judge(route_output):
    for i in route_output:
        if ((rs.CurveLength(i) > serve_range)):
            final_route.append(i)
            route_output.remove(i)
# ---------- end ghpython_script_2 ----------
ghpython_script_3 = GhPythonScript(origin=point, points=point_4, curves=curve_4)  # -> route, points_deduplicate; inputs origin: Point3d, points: list of Point3d, curves: list of Curve
# ---------- ghpython_script_3: Python ----------
__author__ = "Henry"
__version__ = "2018.12.10"

import rhinoscriptsyntax as rs

def curve_flip_determine(curve,origin1):
    a1 = rs.CurveStartPoint(curve)
    a2 = rs.CurveEndPoint(curve)
    l1 = rs.AddLine(a1,origin1)
    l2 = rs.AddLine(a2,origin1)
    if (rs.CurveLength(l1) > rs.CurveLength(l2)):
        temp = a1
        a1 = a2
        a2 = temp
    new = rs.AddLine(a1,a2)
    return(new)

def remove_duplicate(point_group):
    duplicate_group = []
    for i in point_group:
        point_group_temp = point_group
        point_group_temp.remove(i)
        new_group_temp = point_group_temp
        for j in new_group_temp:
            if (i == j):
                duplicate_group.append(i)
    for i in duplicate_group:
        try:
            point_group.remove(i)
            break
        except:
            print('oops')
    return(point_group)

def curve_cross_join(curve1,curve2):
    output = []

    for i in curve1:
        for j in curve2:
            if (rs.CurveStartPoint(j) == rs.CurveEndPoint(i)):
                id = rs.JoinCurves([i,j])
                output.append(id[0])
    return(output)

def grow(point,origin,curve):
    
    new_curve = []

    for i in curve:
        new_curve.append(curve_flip_determine(i,origin))  ## flip the lines to orient to the origin point

    route = []
    check = []

    point = points

    for i in new_curve:
        for j in point:
            if (rs.CurveStartPoint(i) == j):
                route.append(i)

    points_deduplicate = []

    for i in route:
        points_deduplicate.append(rs.CurveEndPoint(i))

    points_deduplicate = remove_duplicate(points_deduplicate)
    
    return(route,points_deduplicate)


route, points_deduplicate = grow(points,origin,curves)
# ---------- end ghpython_script_3 ----------
curve_5 = Curve(ghpython_script_2)
ghpython_script_4 = GhPythonScript(origin=point, points=ghpython_script_3.points_deduplicate, curves=curve_4)  # -> route, points_deduplicate; inputs origin: Point3d, points: list of Point3d, curves: list of Curve; same code as ghpython_script_3
curve_6 = Curve(ghpython_script_3.route)
point_5 = Point(ghpython_script_3.points_deduplicate)
ghpython_script_5 = GhPythonScript()  # -> output; inputs curve1: list, curve2: list
# ---------- ghpython_script_5: Python ----------
__author__ = "Henry"
__version__ = "2018.12.10"

import rhinoscriptsyntax as rs


def curve_cross_join(curve1,curve2):
    output = []

    for i in curve1:
        for j in curve2:
            if (rs.CurveStartPoint(j) == rs.CurveEndPoint(i)):
                id = rs.JoinCurves([i,j])
                output.append(id[0])
    return(output)
# ---------- end ghpython_script_5 ----------

loop_start = LoopStart(Repeat=0, Trigger=Button(), Data=point_5)  # -> port, Counter, Data, Data_2

ghpython_script_6 = GhPythonScript(origin=point, points=loop_start.Data, curves=curve_4)  # -> route, points_deduplicate; inputs origin: Point3d, points: list of Point3d, curves: list of Curve
# ---------- ghpython_script_6: Python ----------
__author__ = "Henry"
__version__ = "2018.12.10"

import rhinoscriptsyntax as rs

point = points
origin = origin
curve = curves

def curve_flip_determine(curve,origin1):
    a1 = rs.CurveStartPoint(curve)
    a2 = rs.CurveEndPoint(curve)
    l1 = rs.AddLine(a1,origin1)
    l2 = rs.AddLine(a2,origin1)
    if (rs.CurveLength(l1) > rs.CurveLength(l2)):
        temp = a1
        a1 = a2
        a2 = temp
    new = rs.AddLine(a1,a2)
    return(new)

def remove_duplicate(point_group):
    duplicate_group = []
    for i in point_group:
        point_group_temp = point_group
        point_group_temp.remove(i)
        new_group_temp = point_group_temp
        for j in new_group_temp:
            if (i == j):
                duplicate_group.append(i)
    for i in duplicate_group:
        point_group.remove(i)
    return(point_group)


new_curve = []

for i in curve:
    new_curve.append(curve_flip_determine(i,origin))

## flip the lines to orient to the origin point


route = []
check = []

point = points

for i in new_curve:
    for j in point:
        if (rs.CurveStartPoint(i) == j):
            route.append(i)

points_deduplicate = []

for i in route:
    points_deduplicate.append(rs.CurveEndPoint(i))

points_deduplicate = remove_duplicate(points_deduplicate)
# ---------- end ghpython_script_6 ----------
flatten_tree = FlattenTree(Tree=ghpython_script_6.route, Path="{0}")
removeduplicatelines = RemoveDuplicateLines(Lines=flatten_tree, Tolerance=0.01)

ghpython_script_7 = GhPythonScript(curve1=flatten(loop_start.Data_2), curve2=flatten(removeduplicatelines))  # -> output; inputs curve1: list, curve2: list
# ---------- ghpython_script_7: Python ----------
__author__ = "Henry"
__version__ = "2018.12.10"

import rhinoscriptsyntax as rs

output = []

for i in curve1:
    for j in curve2:
        if (rs.CurveStartPoint(j) == rs.CurveEndPoint(i)):
            id = rs.JoinCurves([i,j])
            output.append(id[0])

i = 0
j = 0

while(j<=(len(output)-2)):
    if (rs.CurveStartPoint(output[i]) == rs.CurveStartPoint(output[i+1])):
        if (rs.CurveEndPoint(output[i]) == rs.CurveEndPoint(output[i+1])):
            output.pop(i)
    i = i+1
    j = j+1
# ---------- end ghpython_script_7 ----------
curve_7 = Curve(ghpython_script_7)
length = Length(Curve=curve_7)
larger_than = LargerThan(FirstNumber=length, SecondNumber=Slider(100, range=0..500))  # -> LargerThan, OrEqualTo
panel_2 = Panel(length)
cull_pattern = CullPattern(List=curve_7, CullPattern=invert(larger_than.LargerThan))
curve_8 = Curve(cull_pattern)
list_length = ListLength(List=curve_8)
equality = Equality(FirstNumber=list_length, SecondNumber=0)  # -> Equality, Inequality
panel_3 = Panel(equality.Equality)
loop_end = LoopEnd(
    port=loop_start.port,
    Exit=equality.Equality,
    Data_2=ghpython_script_7,
    TimeOutVal=0,
    pausedState=False,
    state="Constant output")  # -> Data, D1
curve_9 = Curve(loop_end.D1)

panel_4 = Panel(ghpython_script_7)
panel_5 = Panel(loop_end.Data)
panel_6 = Panel(loop_end.D1)
list_item = ListItem(List=curve_9, Index=Slider(9, range=0..10), Wrap=True)
