# Grasshopper definition serve_range3.gh (Grasshopper 1.0.7)
# plug-ins: Shortest Walk in Gh, Impala

number_slider = Slider(2000, range=0..5000)
curve = Curve([<curve referenced from the Rhino model> x5000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])
explode = Explode(Curve=curve, Recursive=True)  # -> flatten(Segments), Vertices
point = Point(Point(-590.3117093, -3204.042823, 0))
ghpython_script = GhPythonScript(line=explode.Segments, range=number_slider, difference=800, vector_origin=point)  # -> new; inputs line: list of Curve, range: Int32
# ---------- ghpython_script: Python ----------
__author__ = "Henry"
__version__ = "2019.01.02"

import rhinoscriptsyntax as rs

max = range + difference*1.5
new = []

for i in line:
    end_points = rs.CurveEndPoint(i)
    vector1 = rs.AddLine(vector_origin,end_points)
    length = rs.CurveLength(vector1)
    if (length < max):
        new.append(i)
# ---------- end ghpython_script ----------
end_points = EndPoints(Curve=ghpython_script)  # -> Start, End
point_2 = Point(flatten(end_points.End))
line = Line(StartPoint=point, EndPoint=point_2)
ghpython_script_2 = GhPythonScript(line=line, range=number_slider, difference=800)  # -> new; inputs line: list of Curve, range: Int32
# ---------- ghpython_script_2: Python ----------
__author__ = "Henry"
__version__ = "2019.01.02"

import rhinoscriptsyntax as rs

min = range - difference
max = range + difference
new = []

for i in line:
    length = rs.CurveLength(i)
    if ((length > min) and (length < max)):
        new.append(i)
# ---------- end ghpython_script_2 ----------
shortest_walk = ShortestWalk(Curves=ghpython_script, WantedPath=ghpython_script_2)  # -> ShortestWalk, Succession, Direction, Length; disabled
curve_2 = Curve(shortest_walk.ShortestWalk)
null_item = NullItem(Item=curve_2)  # -> NullFlags, InvalidFlags, Description
cull_pattern = CullPattern(List=curve_2, CullPattern=invert(null_item.NullFlags))
length = Length(Curve=cull_pattern)
quicklt = QuickLT(A=length, B=number_slider)
# flip curves to be oriented to the origin
cull_pattern_2 = CullPattern(List=cull_pattern, CullPattern=quicklt)
curve_3 = Curve(cull_pattern_2)
ghpython_script_3 = GhPythonScript(curve=curve_3, origin=point)  # -> curve; inputs curve: list
# ---------- ghpython_script_3: Python ----------
__author__ = "Henry"
__version__ = "2019.01.02"

import rhinoscriptsyntax as rs

def flip_curve(curve1):
    points_curve = rs.CurveEditPoints(curve1)
    points_curve.reverse()
    curve1 = rs.AddCurve(points_curve,1)

for i in curve:
    start_point = rs.CurveStartPoint(i)
    if (not start_point == origin):
        i = flip_curve(i)
# ---------- end ghpython_script_3 ----------
end_points_2 = EndPoints(Curve=ghpython_script_3)  # -> Start, End
point_3 = Point(end_points_2.End)
vector_2pt = Vector2Pt(PointA=point, PointB=point_3, Unitize=False)  # -> Vector, Length
unit_x = UnitX(Factor=1)
ghpython_script_4 = GhPythonScript(vector1=vector_2pt.Vector, vector2=unit_x)  # -> angle_list; inputs vector1: list
# ---------- ghpython_script_4: Python ----------
__author__ = "Henry"
__version__ = "2019.01.02"

import rhinoscriptsyntax as rs

angle_list = []

for i in vector1:
    angle = rs.VectorAngle(i,vector2)
    if (i[1] < 0):
        angle = -angle
    angle_list.append(angle)
# ---------- end ghpython_script_4 ----------
sort_list = SortList(Keys=ghpython_script_4, ValuesValuesA=point_3)  # -> Keys, ValuesValuesA
polyline = PolyLine(Vertices=sort_list.ValuesValuesA, Closed=True)
# serving range
curve_4 = Curve(polyline)
cluster = Cluster(plane=point)
extrude = Extrude(Base=curve_4, Direction=Vector(0, 0, 8.133683865))
move = Move(Geometry=extrude, Motion=Vector(0, 0, -1.897309624))  # -> Geometry, Transform
cap_holes = CapHoles(Brep=move.Geometry)
trim_with_brep = TrimWithBrep(Curve=ghpython_script, Brep=cap_holes)  # -> Inside, Outside
curve_5 = Curve(trim_with_brep.Inside)

# ==== cluster Cluster
plane = ClusterInput()
rectangle = Rectangle(Plane=plane, XSize=Domain(-10000, 10000), YSize=Domain(-10000, 10000), Radius=0)  # -> Rectangle, Length
boundary_surfaces = BoundarySurfaces(Edges=rectangle.Rectangle)
surfaces = ClusterOutput(boundary_surfaces)
